# Grasshopper definition maze.gh (Grasshopper 1.0.7)

path = FilePath("/Users/jinai/Development/geometry/maze_generator/app/maze.py")
python = GhPythonScript(Code=path, Width=Slider(10, range=0..100), Depth=Slider(5, range=0..100), Height=Slider(5, range=0..100))  # -> Out, A
panel = Panel(python.Out)
